# Grasshopper definition check_urdf.ghx (Grasshopper 1.0.7)

py = GhPythonScript()  # -> filepath
# ---------- py: Python ----------
import os

filename = ghenv.Component.OnPingDocument().FilePath

filepath = os.path.join(os.path.dirname(filename), "..")

filepath = os.path.abspath(filepath)
print filepath
# ---------- end py ----------
panel = Panel(py)
list = ValueList({"IRB4600": "abb_irb4600_40_255,abb_irb4600_40_255", "IRB7600": "abb_irb7600_400_255,abb_irb7600_400_255", "2 Robot Cell": "princeton_cell,princeton_cell", "3 Robot Cell": "princeton_cell,princeton_3rob_cell"}, selected="IRB7600")
panel_2 = Panel("Check URDF")
python = GhPythonScript(name=list)  # -> filepath, folder_name, file_name
# ---------- python: Python ----------
print name

name = name.split(',')

filepath = "{}\urdf\{}.urdf".format(name[0], name[1])
folder_name = name[0]
file_name = name[1]
# ---------- end python ----------
panel_3 = Panel(python.filepath)
python_2 = GhPythonScript(filepath=py, path="catkin", urdf_filename=python.filepath)  # -> urdf_filename, path
# ---------- python_2: Python ----------
import os


urdf_filename = os.path.join(filepath, path, urdf_filename)
print urdf_filename

path = os.path.join(filepath, path)
print path
# ---------- end python_2 ----------
panel_4 = Panel(python_2.urdf_filename)
python_3 = GhPythonScript(
    urdf_filename=python_2.urdf_filename,
    path=python_2.path,
    folder_name=python.folder_name,
    file_name=python.file_name,
    load_geometry=Toggle(True))  # -> model
# ---------- python_3: Python ----------
from compas.robots import LocalPackageMeshLoader
from compas.robots import RobotModel

model = RobotModel.from_urdf_file(urdf_filename)
print model
print path
print folder_name

if load_geometry:
    
    loaders = [LocalPackageMeshLoader(path, folder_name)]
    
    if file_name in ['princeton_cell']:
        loaders.append(LocalPackageMeshLoader(path, 'abb_irb4600_40_255'))
    elif file_name in ['princeton_3rob_cell']:
        loaders.append(LocalPackageMeshLoader(path, 'abb_irb4600_40_255'))
        loaders.append(LocalPackageMeshLoader(path, 'abb_irb7600_400_255'))
    
    model.load_geometry(*loaders)
# ---------- end python_3 ----------
python_4 = GhPythonScript(model=python_3)  # -> G
# ---------- python_4: Python ----------
from compas_ghpython.artists import RobotModelArtist

artist = RobotModelArtist(model)


G = artist.draw_visual()
# ---------- end python_4 ----------
